# Grasshopper definition perastaltic pump.gh (Grasshopper 0.9.76)

# schedule 40 flexble pipe
# 
# outside diameter in mm 33,4; 26.7; 21.3 ; 10.3
panel = Panel("21")
radius_of_pipe = Slider(5.15, range=0..10)
number_slider = Slider(65, range=0..1000)
number_slider_2 = Slider(2, range=0..3)
number_slider_3 = Slider(28, range=0..100)
Z = UnitZ(Factor=Slider(45, range=-100..50))
wheel_size = Slider(11, range=0..110)
number_slider_4 = Slider(9, range=0..100)
pt = Point(<point referenced from the Rhino model>)
nut_sizes = Slider(1.5, range=0..10)
rotate_system = Slider(115, range=0..1000)
internal_pump_size = Slider(20, range=0..100)
rectangle = Rectangle(Plane=pt, XSize=number_slider, YSize=number_slider, Radius=Slider(3, range=0..100))  # -> Rectangle, Length
Z_2 = UnitZ(Factor=Slider(50, range=0..100))
Z_3 = UnitZ(Factor=Slider(62, range=0..100))
rev = Reverse(Vector=Z_2)
extr = Extrude(Base=rectangle.Rectangle, Direction=Z_3)
area = Area(Geometry=rectangle.Rectangle)  # -> Area, Centroid
box = CenterBox(Base=area.Centroid, X="22", Y="22", Z=panel)
move = Move(Geometry=box, Motion=Z)  # -> Geometry, Transform
circle = CircleCNR(Center=area.Centroid, Normal=Vector(0, 0, 1), Radius=Slider(2.5, range=0..10))
offset = Offset(Curve=rectangle.Rectangle, Distance=Slider(-4, range=-50..50), Plane=PlaneXY(0, 0, 0), Corners=area.Centroid)
circle_2 = CircleCNR(Center=area.Centroid, Normal=Vector(0, 0, 1), Radius=nut_sizes)
cp = ControlPoints(Curve=offset)  # -> Points, Weights, Knots
extr_2 = Extrude(Base=circle, Direction=rev)
rad = Radians(Degrees="30")
circle_3 = CircleCNR(Center=cp.Points, Normal=Vector(0, 0, 1), Radius=nut_sizes)
no_of_wheels = Slider(3, range=0..10)
circle_4 = CircleCNR(Center=area.Centroid, Normal=Vector(0, 0, 1), Radius=number_slider_4)
rad_2 = Radians(Degrees=rotate_system)
subtraction = Subtraction(A=internal_pump_size, B=number_slider_4)
Z_4 = UnitZ(Factor=number_slider_2)
circle_5 = CircleCNR(Center=area.Centroid, Normal=Vector(0, 0, 1), Radius=internal_pump_size)
tweencrv = TweenCurve(CurveA=circle_5, CurveB=circle_4, Factor=0.5, BlendType=0)
offset_2 = Offset(Curve=circle_5, Distance=radius_of_pipe, Plane=PlaneXY(0, 0, 0), Corners=1)  # -> flatten(Curve)
divide = DivideCurve(Curve=offset_2, Count=no_of_wheels, Kinks=False)  # -> Points, Tangents, Parameters
boundary = BoundarySurfaces(Edges=[offset_2, circle_2])
rotate = Rotate(Geometry=divide.Points, Angle=rad, Plane=area.Centroid)  # -> Geometry, Transform
circle_6 = CircleCNR(Center=rotate.Geometry, Normal=Vector(0, 0, 1), Radius=Slider(11, range=0..20))
boundary_2 = BoundarySurfaces(Edges=[rectangle.Rectangle, offset_2, circle_3])
boundary_3 = BoundarySurfaces(Edges=circle_6)
sdiff = SolidDifference(BrepsA=boundary, BrepsB=boundary_3)
rotate_2 = Rotate(Geometry=tweencrv, Angle=rad_2, Plane=area.Centroid)  # -> Geometry, Transform
item = ListItem(List=sdiff, Index=0, Wrap=True)
rotate_3 = Rotate(Geometry=circle_4, Angle=rad_2, Plane=area.Centroid)  # -> Geometry, Transform
division = Division(A=number_slider_3, B="2")
divide_2 = DivideCurve(Curve=rotate_2.Geometry, Count=no_of_wheels, Kinks=False)  # -> graft(Points), Tangents, Parameters
move_2 = Move(Geometry=divide_2.Points, Motion=Z_4)  # -> Geometry, Transform
subtraction_2 = Subtraction(A=division, B=radius_of_pipe)
divide_3 = DivideCurve(Curve=rotate_3.Geometry, Count="3", Kinks=False)  # -> Points, Tangents, Parameters
divide_4 = DivideCurve(Curve=circle_5, Count="2", Kinks=False)  # -> Points, Tangents, Parameters
number_slider_5 = Slider(300, range=0..1000)
circle_7 = CircleCNR(Center=divide_2.Points, Normal=Vector(0, 0, 1), Radius=nut_sizes)
Z_5 = UnitZ(Factor=number_slider_3)
Z_6 = UnitZ(Factor=subtraction_2)
rad_3 = Radians(Degrees="60")
Y = UnitY(Factor=1)
circle_8 = CircleCNR(Center=divide_2.Points, Normal=Vector(0, 0, 1), Radius=wheel_size)
rev_2 = Reverse(Vector=Z_5)
move_3 = Move(Geometry=item, Motion=rev_2)  # -> Geometry, Transform
rotate_4 = Rotate(Geometry=circle_4, Angle=rad_3, Plane=area.Centroid)  # -> Geometry, Transform
panel_2 = Panel("-1")
division_2 = Division(A=number_slider, B="2")
ln = Line(StartPoint=divide_2.Points, EndPoint=area.Centroid)
extr_3 = Extrude(Base=move_3.Geometry, Direction=Z_6)
line = LineSDL(Start=divide_4.Points, Direction=Y, Length=division_2)
boundary_4 = BoundarySurfaces(Edges=circle_8)
panel_3 = Panel(subtraction_2)
rotate_5 = Rotate(Geometry=rotate_4.Geometry, Angle=rad_2, Plane=area.Centroid)  # -> Geometry, Transform
offset_3 = Offset(Curve=rotate_5.Geometry, Distance=subtraction, Plane=PlaneXY(0, 0, 0), Corners=1)
circlett = CircleTanTan(CurveA=rotate_5.Geometry, CurveB=offset_3, Point=divide_3.Points)
divide_5 = DivideCurve(Curve=circlett, Count="3", Kinks=False)  # -> Points, Tangents, Parameters
extr_4 = Extrude(Base=flatten(boundary_2), Direction=rev_2)
circle_9 = CircleCNR(Center=area.Centroid, Normal=Vector(0, 0, 1), Radius=nut_sizes)
bang = ExplodeTree(Data=divide_5.Points)  # -> Branch0, Branch1, Branch2
shatter = Shatter(Curve=circle_5, Parameters=divide_4.Parameters)
item_2 = ListItem(List=shatter, Index="1", Wrap=True)
subtraction_3 = Subtraction(A=number_slider_3, B=subtraction_2)
divide_6 = DivideCurve(Curve=rotate_5.Geometry, Count="3", Kinks=False)  # -> Points, Tangents, Parameters
Z_7 = UnitZ(Factor=number_slider_2)
join = JoinCurves(Curves=[item_2, line], Preserve=False)
pipe = Pipe(Curve=join, Radius=radius_of_pipe, Caps=radius_of_pipe)
Z_8 = UnitZ(Factor=subtraction_3)
cap = CapHoles(Brep=pipe)
item_3 = ListItem(List=flatten(bang.Branch2), Index=2, Wrap=True)  # -> Item, Item1, Item2
item_4 = ListItem(List=bang.Branch1, Index=1, Wrap=True)  # -> Item, Item1, Item2
item_5 = ListItem(List=bang.Branch0, Index=0, Wrap=True)  # -> Item, Item1, Item2

# ---- group: thickness of pipe
multiplication = Multiplication(A=radius_of_pipe, B="2")

# ----
Z_9 = UnitZ(Factor=multiplication)
rev_3 = Reverse(Vector=Z_9)
addition = Addition(A=multiplication, B=number_slider_2)
extr_5 = Extrude(Base=boundary_4, Direction=rev_3)
rev_4 = Reverse(Vector=Z_8)
extr_6 = Extrude(Base=offset_3, Direction=rev_4)
division_3 = Division(A=number_slider_3, B="2")
item_6 = ListItem(List=divide_6.Points, Index=0, Wrap=True)  # -> Item, Item1, Item2
Z_10 = UnitZ(Factor=division_3)
pt_2 = Point(item_4.Item2)
cap_2 = CapHoles(Brep=extr_6)
pt_3 = Point(item_5.Item1)
pt_4 = Point(item_4.Item)
pt_5 = Point(item_4.Item1)
rev_5 = Reverse(Vector=Z_7)
pt_6 = Point(item_5.Item)
pt_7 = Point(item_5.Item2)
pt_8 = Point(item_3.Item)
pt_9 = Point(item_3.Item1)
pt_10 = Point(item_3.Item2)
pt_11 = Point(graft(item_6.Item))
pt_12 = Point(item_6.Item1)
pt_13 = Point(item_6.Item2)
rev_6 = Reverse(Vector=Z_10)
move_4 = Move(Geometry=flatten(cap), Motion=rev_6)  # -> Geometry, Transform
preview = CustomPreview(Geometry=move_4.Geometry, Shader=ColourSwatch(SwatchColor=RGBA(232, 232, 232, 180)))
move_5 = Move(Geometry=cap_2, Motion=rev_5)  # -> Geometry, Transform
sdiff_2 = SolidDifference(BrepsA=extr_3, BrepsB=move_5.Geometry)
data = Data(subtraction_2)
addition_2 = Addition(A=addition, B=data)
Z_11 = UnitZ(Factor=addition)
addition_3 = Addition(A=number_slider_2, B=addition_2)
arc = Arc3Pt(PointA=pt_3, PointB=pt_6, PointC=pt_7)  # -> Arc, Plane, Radius
arc_2 = Arc3Pt(PointA=pt_4, PointB=pt_2, PointC=pt_5)  # -> Arc, Plane, Radius
arc_3 = Arc3Pt(PointA=pt_8, PointB=pt_9, PointC=pt_10)  # -> Arc, Plane, Radius
sdiff_3 = SolidDifference(BrepsA=extr_4, BrepsB=flatten(move_4.Geometry))
panel_4 = Panel(sdiff_3)
Z_12 = UnitZ(Factor=addition_2)
rev_7 = Reverse(Vector=Z_11)
panel_5 = Panel(addition_3)
arc_4 = Arc3Pt(PointA=pt_8, PointB=pt_12, PointC=pt_4)  # -> Arc, Plane, Radius
arc_5 = Arc3Pt(PointA=pt_10, PointB=pt_13, PointC=pt_7)  # -> Arc, Plane, Radius
arc_6 = Arc3Pt(PointA=pt_5, PointB=pt_11, PointC=pt_3)  # -> Arc, Plane, Radius
join_2 = JoinCurves(Curves=[arc_4.Arc, arc_5.Arc, arc_6.Arc, arc_3.Arc, arc_2.Arc, arc.Arc], Preserve=False)  # -> flatten(Curves)
Z_13 = UnitZ(Factor=number_slider_2)
move_6 = Move(Geometry=extr_3, Motion=Z_12)  # -> Geometry, Transform
boundary_5 = BoundarySurfaces(Edges=flatten([join_2, circle_9, circle_7]))
sdiff_4 = SolidDifference(BrepsA=boundary_5, BrepsB=flatten(boundary_4))
item_7 = ListItem(List=sdiff_4, Index=0, Wrap=True)
extr_7 = Extrude(Base=item_7, Direction=rev_3)
rev_8 = Reverse(Vector=Z_13)
extr_8 = Extrude(Base=boundary_5, Direction=rev_8)
Z_14 = UnitZ(Factor=number_slider_2)
Z_15 = UnitZ(Factor=Slider(-8, range=-30..10))
move_7 = Move(Geometry=extr_8, Motion=Z_14)  # -> Geometry, Transform
move_8 = Move(Geometry=move_7.Geometry, Motion=rev_7)  # -> Geometry, Transform
merge = Merge(Data1=move_7.Geometry, Data2=extr_7, Data3=move_8.Geometry, Data4=extr_5)
move_9 = Move(Geometry=merge, Motion=Z_15)  # -> Geometry, Transform
preview_2 = CustomPreview(Geometry=move_9.Geometry, Shader=ColourSwatch(SwatchColor=RGBA(240, 240, 240, 117)))
