# Grasshopper definition vslotgh.gh (Grasshopper 0.9.76)
# plug-ins: LunchBox

section_size = Slider(20, range=0..1000)
offset = Slider(-3, range=-100..0)
number_slider = Slider(5, range=0..100)
z_feet = Slider(130, range=0..1000)
general_size = Slider(368, range=0..1000)
move_x = Slider(0.382, range=0.2..0.9)
move_y = Slider(0.88, range=0.17..0.9)
move_z = Slider(109, range=55..114)
move_bed = Slider(47, range=47..228)
claw_z = Slider(-44, range=-85..-44)
conveyor_length = Slider(916, range=0..1000)
z_axis_length = Slider(196, range=0..1000)
galapagos = Galapagos(fitness=dist, gene=[move_x, move_y, move_z])
claw_x = Slider(0.3, range=0..1)
claw_z_2 = Slider(66, range=0..150)
pt = Point(<point referenced from the Rhino model>)
subtraction = Subtraction(A=general_size, B=section_size)
rectangle = Rectangle(Plane=pt, XSize=general_size, YSize=general_size, Radius=0)  # -> Rectangle, Length
cp = ControlPoints(Curve=rectangle.Rectangle)  # -> Points, Weights, Knots
explode = Explode(Curve=rectangle.Rectangle, Recursive=True)  # -> Segments, Vertices
Z = UnitZ(Factor=z_feet)
Z_2 = UnitZ(Factor=z_feet)
Z_3 = UnitZ(Factor=z_feet)
Z_4 = UnitZ(Factor=z_feet)
item = ListItem(List=explode.Segments, Index=0, Wrap=True)  # -> Item, Item1, Item2, Item3
item_2 = ListItem(List=cp.Points, Index=0, Wrap=True)  # -> Item, Item1, Item2, Item3
cluster = Cluster(R=number_slider, P=item_2.Item, X=section_size, Y=section_size, D=offset)  # -> C, R_2
cluster_2 = Cluster(R=number_slider, P=item_2.Item2, X=section_size, Y=section_size, D=offset)  # -> C, R_2
cluster_3 = Cluster(R=number_slider, P=item_2.Item3, X=section_size, Y=section_size, D=offset)  # -> C, R_2
cluster_4 = Cluster(R=number_slider, P=item_2.Item1, X=section_size, Y=section_size, D=offset)  # -> C, R_2
Z_5 = UnitZ(Factor=z_feet)
boundary = BoundarySurfaces(Edges=[cluster.C, cluster.R_2])
boundary_2 = BoundarySurfaces(Edges=[cluster_4.C, cluster_4.R_2])
boundary_3 = BoundarySurfaces(Edges=[cluster_3.C, cluster_3.R_2])
boundary_4 = BoundarySurfaces(Edges=[cluster_2.C, cluster_2.R_2])
crv = Curve(item.Item2)
extr = Extrude(Base=boundary_3, Direction=Z_3)
extr_2 = Extrude(Base=boundary_2, Direction=Z_4)
extr_3 = Extrude(Base=boundary_4, Direction=Z_2)
extr_4 = Extrude(Base=boundary, Direction=Z)
eval = EvaluateCurve(Curve=reparameterize(item.Item1), Parameter=move_y)  # -> Point, Tangent, Angle
move = Move(Geometry=[boundary_2, boundary], Motion=Z_4)  # -> Geometry, Transform
X = UnitX(Factor=1)
bbox = BoundingBox(Content=move.Geometry, Plane=PlaneXY(0, 0, 0))  # -> Box, Box_2
cluster_5 = Cluster(R=number_slider, P=eval.Point, X=section_size, Y=section_size, D=offset)  # -> C, R_2
edges = BrepEdges(Brep=bbox.Box)  # -> Naked, Interior, NonManifold
rev = Reverse(Vector=X)
move_2 = Move(Geometry=[boundary_4, boundary_2], Motion=Z_4)  # -> Geometry, Transform
explode_2 = Explode(Curve=edges.Naked, Recursive=True)  # -> flatten(Segments), Vertices
bbox_2 = BoundingBox(Content=move_2.Geometry, Plane=PlaneXY(0, 0, 0))  # -> Box, Box_2
line = LineSDL(Start=eval.Point, Direction=rev, Length=subtraction)
rad = Radians(Degrees="90")
edges_2 = BrepEdges(Brep=bbox_2.Box)  # -> Naked, Interior, NonManifold
item_3 = ListItem(List=explode_2.Segments, Index="2", Wrap=True)
end = EndPoints(Curve=item_3)  # -> Start, End
move_3 = Move(Geometry=line, Motion=Z_4)  # -> Geometry, Transform
X_2 = UnitX(Factor=subtraction)
rad_2 = Radians(Degrees="90")
explode_3 = Explode(Curve=edges_2.Naked, Recursive=True)  # -> flatten(Segments), Vertices
rot3d = Rotate3D(Geometry=move.Geometry, Angle=rad, Center=end.Start, Axis=item_3)  # -> Geometry, Transform
eval_2 = EvaluateCurve(Curve=reparameterize(move_3.Geometry), Parameter=move_x)  # -> Point, Tangent, Angle
rev_2 = Reverse(Vector=Z_4)
boundary_5 = BoundarySurfaces(Edges=[cluster_5.C, cluster_5.R_2])
bbox_3 = BoundingBox(Content=boundary_5, Plane=PlaneXY(0, 0, 0))  # -> Box, Box_2
edges_3 = BrepEdges(Brep=bbox_3.Box)  # -> Naked, Interior, NonManifold
explode_4 = Explode(Curve=edges_3.Naked, Recursive=True)  # -> flatten(Segments), Vertices
Y = UnitY(Factor=subtraction)
rev_3 = Reverse(Vector=X_2)
item_4 = ListItem(List=explode_4.Segments, Index=Slider(3, range=0..10), Wrap=True)
item_5 = ListItem(List=explode_3.Segments, Index="3", Wrap=True)
end_2 = EndPoints(Curve=item_5)  # -> Start, End
rot3d_2 = Rotate3D(Geometry=move_2.Geometry, Angle=rad_2, Center=end_2.Start, Axis=item_5)  # -> Geometry, Transform
extr_5 = Extrude(Base=rot3d.Geometry, Direction=Y)
move_4 = Move(Geometry=rot3d.Geometry, Motion=rev_2)  # -> flatten(Geometry), Transform
cluster_6 = Cluster(R=number_slider, P=eval_2.Point, X=section_size, Y=section_size, D=offset)  # -> C, R_2
X_3 = UnitX(Factor=section_size)
rot3d_3 = Rotate3D(Geometry=boundary_5, Angle=rad_2, Center=eval.Point, Axis=item_4)  # -> Geometry, Transform
X_4 = UnitX(Factor=subtraction)
X_5 = UnitX(Factor=section_size)
extr_6 = Extrude(Base=rot3d_2.Geometry, Direction=rev_3)
boundary_6 = BoundarySurfaces(Edges=[cluster_6.R_2, cluster_6.C])
item_6 = ListItem(List=move_4.Geometry, Index=0, Wrap=True)  # -> Item, Item1
Y_2 = UnitY(Factor=section_size)
Y_3 = UnitY(Factor=section_size)
rev_4 = Reverse(Vector=X_4)
rev_5 = Reverse(Vector=X_3)
extr_7 = Extrude(Base=rot3d_3.Geometry, Direction=rev_4)
move_5 = Move(Geometry=eval_2.Point, Motion=Y_3)  # -> Geometry, Transform
item_7 = ListItem(List=extr_6, Index=0, Wrap=True)
number_slider_2 = Slider(27, range=0..100)
Z_6 = UnitZ(Factor=move_z)
move_6 = Move(Geometry=boundary_6, Motion=Y_2)  # -> Geometry, Transform
Z_7 = UnitZ(Factor=z_axis_length)
move_7 = Move(Geometry=item_6.Item, Motion=rev_5)  # -> Geometry, Transform
move_8 = Move(Geometry=item_6.Item1, Motion=X_5)  # -> Geometry, Transform
Y_4 = UnitY(Factor=section_size)
Y_5 = UnitY(Factor=conveyor_length)
Z_8 = UnitZ(Factor=number_slider_2)
move_9 = Move(Geometry=extr_7, Motion=Z_4)  # -> Geometry, Transform
extr_8 = Extrude(Base=move_6.Geometry, Direction=Z_7)
rev_6 = Reverse(Vector=Z_6)
extr_9 = Extrude(Base=[move_7.Geometry, move_8.Geometry], Direction=Y_5)
move_10 = Move(Geometry=move_9.Geometry, Motion=Z_8)  # -> Geometry, Transform
move_11 = Move(Geometry=item_7, Motion=Y_4)  # -> Geometry, Transform
crv_2 = Curve(item.Item1)
move_12 = Move(Geometry=extr_8, Motion=rev_6)  # -> Geometry, Transform
X_6 = UnitX(Factor=subtraction)
X_7 = UnitX(Factor=section_size)
rev_7 = Reverse(Vector=X_6)
extr_10 = Extrude(Base=crv_2, Direction=rev_7)
bbox_4 = BoundingBox(Content=rot3d_3.Geometry, Plane=PlaneXY(0, 0, 0))  # -> Box, Box_2
move_13 = Move(Geometry=move_12.Geometry, Motion=X_7)  # -> Geometry, Transform
Z_9 = UnitZ(Factor=section_size)
number_slider_3 = Slider(1, range=0..1)
Z_10 = UnitZ(Factor=claw_z)
move_14 = Move(Geometry=bbox_4.Box, Motion=Z_4)  # -> Geometry, Transform
move_15 = Move(Geometry=extr_10, Motion=Z_9)  # -> Geometry, Transform

# ---- group: claw option one
move_16 = Move(Geometry=crv, Motion=Z_4)  # -> Geometry, Transform
flip = FlipCurve(Curve=move_16.Geometry)  # -> Curve, Flag
eval_3 = EvaluateCurve(Curve=reparameterize(flip.Curve), Parameter=claw_x)  # -> Point, Tangent, Angle
cluster_7 = Cluster(R=number_slider, P=eval_3.Point, X=section_size, Y=section_size, D=offset)  # -> C, R_2
boundary_7 = BoundarySurfaces(Edges=[cluster_7.R_2, cluster_7.C])
Y_6 = UnitY(Factor=section_size)
move_17 = Move(Geometry=boundary_7, Motion=Y_6)  # -> Geometry, Transform
Z_11 = UnitZ(Factor=z_axis_length)
Z_12 = UnitZ(Factor=claw_z_2)
extr_11 = Extrude(Base=move_17.Geometry, Direction=Z_11)
rev_8 = Reverse(Vector=Z_12)
move_18 = Move(Geometry=extr_11, Motion=rev_8)  # -> Geometry, Transform

# ----
area = Area(Geometry=move_14.Geometry)  # -> Area, Centroid
Y_7 = UnitY(Factor=Slider(9, range=0..100))
move_19 = Move(Geometry=move_11.Geometry, Motion=Z_10)  # -> Geometry, Transform
number_slider_4 = Slider(1.5, range=0..10)
move_20 = Move(Geometry=move_16.Geometry, Motion=Y_4)  # -> Geometry, Transform
scale = Scale(Geometry=move_14.Geometry, Center=area.Centroid, Factor=number_slider_4)  # -> Geometry, Transform
X_8 = UnitX(Factor=1)
Y_8 = UnitY(Factor=move_bed)
volume = Volume(Geometry=move_19.Geometry)  # -> Volume, Centroid
move_21 = Move(Geometry=[move_12.Geometry, move_13.Geometry], Motion=Y_7)  # -> Geometry, Transform
move_22 = Move(Geometry=move_15.Geometry, Motion=Y_8)  # -> Geometry, Transform
scale_nu = ScaleNU(Geometry=move_19.Geometry, Plane=volume.Centroid, ScaleX=Slider(1.1, range=0..10), ScaleY=1, ScaleZ=1)  # -> Geometry, Transform
volume_2 = Volume(Geometry=move_21.Geometry)  # -> Volume, Centroid
rad_3 = Radians(Degrees=Slider(-90, range=-90..100))
scale_nu_2 = ScaleNU(Geometry=scale.Geometry, Plane=area.Centroid, ScaleX=1, ScaleY=1, ScaleZ=number_slider_4)  # -> Geometry, Transform
move_23 = Move(Geometry=move_21.Geometry, Motion=Z_8)  # -> Geometry, Transform
Z_13 = UnitZ(Factor=Slider(15, range=0..100))
Z_14 = UnitZ(Factor=number_slider_2)
extr_12 = Extrude(Base=move_22.Geometry, Direction=Z_13)
md_slider = MDSlider(slider_value=Point(0.5, 0.5, 0.5), SliderMode=0, x_domain=Domain(0, 1), y_domain=Domain(0, 1), z_domain=Domain(0, 1))
move_24 = Move(Geometry=scale_nu_2.Geometry, Motion=Z_14)  # -> Geometry, Transform
Z_15 = UnitZ(Factor=Slider(-50, range=-50..100))
join = BrepJoin(Breps=flatten(move_23.Geometry))  # -> Breps, Closed
bbox_5 = BoundingBox(Content=flatten(join.Breps), Plane=PlaneXY(0, 0, 0), UnionBox=True)  # -> Box, Box_2
scale_nu_3 = ScaleNU(Geometry=bbox_5.Box, Plane=move_5.Geometry, ScaleX=1, ScaleY=Slider(0.3, range=0..1), ScaleZ=number_slider_3)  # -> Geometry, Transform
edges_4 = BrepEdges(Brep=scale_nu_3.Geometry)  # -> flatten(Naked), Interior, NonManifold
cp_2 = ControlPoints(Curve=flatten(edges_4.Interior))  # -> flatten(Points), Weights, Knots
panel = Panel(move_24.Geometry)
Y_9 = UnitY(Factor=Slider(30, range=0..100))
item_8 = ListItem(List=move_24.Geometry, Index=0, Wrap=True)
item_9 = ListItem(List=cp_2.Points, Index=0, Wrap=True)
rot3d_4 = Rotate3D(Geometry=scale_nu_3.Geometry, Angle=rad_3, Center=item_9, Axis=X_8)  # -> Geometry, Transform
evalsrf = EvaluateSurface(Surface=item_8, Point=md_slider)  # -> Point, Normal, Frame
number_slider_5 = Slider(10, range=0..100)
move_25 = Move(Geometry=scale_nu_3.Geometry, Motion=Y_9)  # -> Geometry, Transform
rev_9 = Reverse(Vector=evalsrf.Normal)
subtraction_2 = Subtraction(A=general_size, B=section_size)
amp = Amplitude(Vector=rev_9, Amplitude=number_slider_5)
scale_nu_4 = ScaleNU(Geometry=rot3d_4.Geometry, Plane=move_5.Geometry, ScaleX=1, ScaleY=Slider(0.4, range=0..1), ScaleZ=number_slider_3)  # -> Geometry, Transform
subtraction_3 = Subtraction(A=subtraction_2, B=number_slider_5)
number_slider_6 = Slider(6, range=0..10)
extr_13 = Extrude(Base=move_24.Geometry, Direction=amp)
Y_10 = UnitY(Factor="300")
X_9 = UnitX(Factor=subtraction_3)
debrep = DeconstructBrep(Brep=scale_nu_4.Geometry)  # -> Faces, Edges, Vertices
rev_10 = Reverse(Vector=X_9)
move_26 = Move(Geometry=extr_13, Motion=rev_10)  # -> Geometry, Transform
item_10 = ListItem(List=debrep.Faces, Index=0, Wrap=True)
edges_5 = BrepEdges(Brep=item_10)  # -> Naked, Interior, NonManifold
quads = QuadPanels(Surface=item_10, UDivisions=Slider(3, range=0..10), VDivisions=number_slider_6)
area_2 = Area(Geometry=quads)  # -> Area, Centroid
circle = CircleCNR(Center=area_2.Centroid, Normal=Vector(0, 0, 1), Radius=Slider(4, range=0..100))
pt_2 = Point(<point referenced from the Rhino model>)
join_2 = JoinCurves(Curves=edges_5.Naked, Preserve=False)
boundary_8 = BoundarySurfaces(Edges=flatten([join_2, circle]))
dist = Distance(PointA=area_2.Centroid, PointB=pt_2)
Z_16 = UnitZ(Factor=number_slider_6)
extr_14 = Extrude(Base=boundary_8, Direction=Z_16)

move_27 = Move(Geometry=[boundary_4, boundary_2, boundary_3, boundary], Motion=Z_5)  # -> Geometry, Transform
Z_17 = UnitZ(Factor=section_size)
# http://www.ratrig.com/hardware/openbuilds-three-way-cube-corner-connector-v-slot.html
swatch = ColourSwatch(SwatchColor=RGB(0, 0, 0))
bbox_6 = BoundingBox(Content=move_27.Geometry, Plane=PlaneXY(0, 0, 0))  # -> Box, Box_2
extr_15 = Extrude(Base=bbox_6.Box, Direction=Z_17)
preview = CustomPreview(Geometry=[extr_15, extr_13, move_26.Geometry, extr_14, scale_nu_3.Geometry], Shader=swatch)

# ==== cluster Cluster
P = ClusterInput()
X = ClusterInput()
Y = ClusterInput()
D = ClusterInput()
R = ClusterInput()

# ---- group: V-SLOT
rectangle = Rectangle(Plane=P, XSize=X, YSize=Y, Radius=0)  # -> Rectangle, Length
offset = Offset(Curve=rectangle.Rectangle, Distance=D, Plane=PlaneXY(0, 0, 0), Corners=1)
explode = Explode(Curve=offset, Recursive=True)  # -> Segments, Vertices
explode_2 = Explode(Curve=offset, Recursive=True)  # -> Segments, Vertices
explode_3 = Explode(Curve=rectangle.Rectangle, Recursive=True)  # -> Segments, Vertices
area = Area(Geometry=rectangle.Rectangle)  # -> Area, Centroid
split = SplitList(List=explode_2.Vertices, Index="1")  # -> ListA, ListB
shift = ShiftList(List=split.ListB, Shift=1, Wrap=True)  # -> graft(List)
eval = EvaluateCurve(Curve=reparameterize(explode.Segments), Parameter="0.5")  # -> Point, Tangent, Angle
eval_2 = EvaluateCurve(Curve=reparameterize(explode_3.Segments), Parameter="0.5")  # -> Point, Tangent, Angle
scale = Scale(Geometry=explode.Segments, Center=eval.Point, Factor=Slider(0.4, range=0..1))  # -> flatten(Geometry), Transform
scale_2 = Scale(Geometry=explode_3.Segments, Center=eval_2.Point, Factor=Slider(0.5, range=0..1))  # -> flatten(Geometry), Transform
item = ListItem(List=scale.Geometry, Index=0, Wrap=True)  # -> Item, Item1, Item2, Item3
item_2 = ListItem(List=scale_2.Geometry, Index=0, Wrap=True)  # -> Item, Item1, Item2, Item3
panel = Panel(scale_2.Geometry)
panel_2 = Panel("1.1")
loft = Loft(
    Curves=[item.Item, item_2.Item],
    Options={Adjust=False, Closed=False, LoftEnds=0, LoftSimp=0, LoftType=0, Rebuild=10, Refit=0.01})
loft_2 = Loft(
    Curves=[item.Item1, item_2.Item1],
    Options={Adjust=False, Closed=False, LoftEnds=0, LoftSimp=0, LoftType=0, Rebuild=10, Refit=0.01})
loft_3 = Loft(
    Curves=[item.Item2, item_2.Item2],
    Options={Adjust=False, Closed=False, LoftEnds=0, LoftSimp=0, LoftType=0, Rebuild=10, Refit=0.01})
loft_4 = Loft(
    Curves=[item.Item3, item_2.Item3],
    Options={Adjust=False, Closed=False, LoftEnds=0, LoftSimp=0, LoftType=0, Rebuild=10, Refit=0.01})
flatten = FlattenTree(Tree=[rectangle.Rectangle, offset], Path="{0}")
flatten_2 = FlattenTree(Tree=[loft_2, loft_3, loft_4, loft], Path="{0}")
circle = CircleCNR(Center=area.Centroid, Normal=Vector(0, 0, 1), Radius=R)
rdiff = RegionDifference(CurvesA=rectangle.Rectangle, CurvesB=flatten_2)  # -> flatten(Result)

# ----
C = ClusterOutput(circle)
R_2 = ClusterOutput(rdiff)
